# Grasshopper definition sine curve between points.gh (Grasshopper 0.9.76)

# ---- group: Bubble Chart Primitive
pt = Point(<point referenced from the Rhino model>)
pt_2 = Point(<point referenced from the Rhino model>)
cluster = Cluster(A=pt, B=pt_2)
tag = TextTag3D(Location=pt_2, Text="Hello", Size=Slider(0.59, range=0..1), Justification=5)
intcrv = Interpolate(Vertices=cluster, Degree=3, Periodic=False, KnotStyle=1)  # -> Curve, Length, Domain
circle = CircleCNR(Center=[pt, pt_2], Normal=Vector(0, 0, 1), Radius=Slider(1.89, range=0..10))

# ----
curvepoint = PointOnCurve(parameter=0.364)

# ---- group: Sine Curve From Points
pt_3 = Point(<point referenced from the Rhino model>)
pt_4 = Point(<point referenced from the Rhino model>)
number_slider = Slider(39, range=0..100)
ln = Line(StartPoint=pt_3, EndPoint=pt_4)
pi = Pi(Factor=Slider(2, range=0..10))
range = Range(Domain=Domain(0, 1), Steps=number_slider)
divide = DivideCurve(Curve=ln, Count=number_slider, Kinks=False)  # -> Points, Tangents, Parameters
Z = UnitZ(Factor=1)
range_2 = Range(Domain=pi, Steps=number_slider)
xprod = CrossProduct(VectorA=divide.Tangents, VectorB=Z, Unitize=False)  # -> Vector, Length
sin = Sine(Value=range_2)
multiplication = Multiplication(A=Slider(0.2, range=0..10), B=sin)
amp = Amplitude(Vector=xprod.Vector, Amplitude=multiplication)
move = Move(Geometry=divide.Points, Motion=amp)  # -> Geometry, Transform
intcrv_2 = Interpolate(Vertices=move.Geometry, Degree=3, Periodic=False, KnotStyle=1)  # -> Curve, Length, Domain

# ==== cluster Cluster
A = ClusterInput()
B = ClusterInput()
number_slider = Slider(39, range=0..100)
ln = Line(StartPoint=A, EndPoint=B)
pi = Pi(Factor=Slider(2, range=0..10))
range = Range(Domain=Domain(0, 1), Steps=number_slider)
divide = DivideCurve(Curve=ln, Count=number_slider, Kinks=False)  # -> Points, Tangents, Parameters
Z = UnitZ(Factor=1)
range_2 = Range(Domain=pi, Steps=number_slider)
xprod = CrossProduct(VectorA=divide.Tangents, VectorB=Z, Unitize=False)  # -> Vector, Length
sin = Sine(Value=range_2)
multiplication = Multiplication(A=Slider(0.2, range=0..10), B=sin)
amp = Amplitude(Vector=xprod.Vector, Amplitude=multiplication)
move = Move(Geometry=divide.Points, Motion=amp)  # -> Geometry, Transform
G = ClusterOutput(move.Geometry)
